# Grasshopper definition Conflict data automation.gh (Grasshopper 1.0.7)
# plug-ins: Pufferfish

# ----
# Coffine margin
number_slider = Slider(10, range=0..100)

# ----
# Coffine gap
number_slider_2 = Slider(3, range=0..100)

# ----
# File
panel = Panel("   Z:\NID\25-2026\Sem 3\Tangible\Important\GH_master_card_data.csv")

# ----
# Continant
panel_2 = Panel("Europe")

# ----
# Input
x_location = Slider(0, range=0..100)
minimum_card_height = Slider(65, range=0..100)
width = Slider(40, range=0..100)
height = Slider(100, range=0..100)
gap = Slider(1, range=0..1)
y_location = Slider(0, range=0..10)
maximum_card_height = Slider(135, range=0..1000)

number_slider_3 = Slider(9.6, range=0..20)
x_location_2 = Slider(100, range=0..100)
minimum_card_height_2 = Slider(65, range=0..100)
# Input
maximum_card_height_2 = Slider(135, range=0..1000)
width_2 = Slider(40, range=0..100)
height_2 = Slider(100, range=0..100)
gap_2 = Slider(1, range=0..1)
number_slider_4 = Slider(9.6, range=0..20)
width_3 = Slider(40, range=0..100)
height_3 = Slider(100, range=0..100)
gap_3 = Slider(1, range=0..1)
minimum_card_height_3 = Slider(65, range=0..100)
maximum_card_height_3 = Slider(135, range=0..1000)
minimum_card_height_4 = Slider(65, range=0..100)
# Input
maximum_card_height_4 = Slider(135, range=0..1000)
width_4 = Slider(40, range=0..100)
height_4 = Slider(100, range=0..100)
gap_4 = Slider(1, range=0..1)
number_slider_5 = Slider(9.6, range=0..20)
number_slider_6 = Slider(9.6, range=0..20)
height_5 = Slider(100, range=0..100)
minimum_card_height_5 = Slider(65, range=0..100)
maximum_card_height_5 = Slider(135, range=0..1000)
width_5 = Slider(40, range=0..100)
gap_5 = Slider(1, range=0..1)
number_slider_7 = Slider(9.6, range=0..20)
ghpython_script = GhPythonScript(
    csv_path=panel,
    region_filter=panel_2,
    card_w=width,
    card_h=height,
    card_t=number_slider_3,
    gap=gap,
    start_x=x_location,
    start_y=y_location,
    min_card_h=minimum_card_height,
    max_card_h=maximum_card_height)  # -> out, cards, stripes, colors, labels, card_info, country_pts, country_names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
# ---------- ghpython_script: Python ----------
import Rhino.Geometry as rg
import System.Drawing as sd
import csv
import math

cards = []
top_cards = []
text_engrave_curves = []
stripes = []
colors = []
labels = []
country_names = []
country_pts = []
region_pts = []
region_names = []
card_info = []

# 4 conflict types in stacking order bottom->top
TYPES = [
    ("Intrastate_pct",  sd.Color.FromArgb(68, 114, 196)),   # blue
    ("OneSided_pct",    sd.Color.FromArgb(192, 0, 0)),      # red
    ("NonState_pct",    sd.Color.FromArgb(112, 173, 71)),   # green
    ("Interstate_pct",  sd.Color.FromArgb(112, 48, 160)),   # purple
]

rows = []
with open(csv_path, "r") as f:
    reader = csv.DictReader(f)
    for row in reader:
        if region_filter and row["Region"] != region_filter:
            continue
        rows.append(row)

# Define min and max height bounds for the variable cards
h_min = min_card_h if "min_card_h" in globals() else card_h * 0.65
h_max = max_card_h if "max_card_h" in globals() else card_h * 1.35

# Extract and find log-scale bounds for TotalDeaths
death_vals = [max(1.0, float(r["TotalDeaths"])) for r in rows]
min_log = math.log10(min(death_vals)) if death_vals else 0.0
max_log = math.log10(max(death_vals)) if death_vals else 1.0

def get_card_height(deaths):
    if max_log == min_log:
        return (h_min + h_max) / 2.0
    val_log = math.log10(max(1.0, float(deaths)))
    t = (val_log - min_log) / (max_log - min_log)
    return h_min + t * (h_max - h_min)

# Clearance gap above the tallest possible bottom card
clear_dist = card_gap_z if "card_gap_z" in globals() else card_h * 0.25
z_top_base = h_max + clear_dist  # Common horizontal baseline for all top cards

x_cursor = start_x
current_region = None
region_gap = card_w * 2

for row in rows:
    region = row["Region"]
    if current_region is not None and region != current_region:
        x_cursor += region_gap
    if region != current_region:
        region_pts.append(rg.Point3d(x_cursor - card_w * 0.75, start_y, h_max * 0.5))
        region_names.append(region)
    current_region = region

    idx = int(row["CardIndex"])
    country = row["Country"]
    total_deaths = float(row["TotalDeaths"])

    # Dynamic height for this specific country's cards
    current_h = get_card_height(total_deaths)

    x0 = x_cursor
    x1 = x_cursor + card_w

    # Shared proportional cutout dimensions based on current_h
    cut_w = card_w * 0.12
    cut_h = current_h * 0.10
    cut_margin = current_h * 0.05

    # --- 1. Bottom Card Profile (Starts at Z = 0) ---
    z_cut_top = current_h - cut_margin
    z_cut_bottom = z_cut_top - cut_h

    pts_bottom = [
        rg.Point3d(x0, 0, 0),
        rg.Point3d(x1, 0, 0),
        rg.Point3d(x1, 0, z_cut_bottom),
        rg.Point3d(x1 - cut_w, 0, z_cut_bottom),
        rg.Point3d(x1 - cut_w, 0, z_cut_top),
        rg.Point3d(x1, 0, z_cut_top),
        rg.Point3d(x1, 0, current_h),
        rg.Point3d(x0, 0, current_h),
        rg.Point3d(x0, 0, z_cut_top),
        rg.Point3d(x0 + cut_w, 0, z_cut_top),
        rg.Point3d(x0 + cut_w, 0, z_cut_bottom),
        rg.Point3d(x0, 0, z_cut_bottom),
        rg.Point3d(x0, 0, 0),
    ]
    card_poly = rg.Polyline(pts_bottom).ToNurbsCurve()

    base_breps = rg.Brep.CreatePlanarBreps(card_poly, 0.001)
    if base_breps:
        base_face = base_breps[0].Faces[0]
        solid_brep = base_face.CreateExtrusion(
            rg.Line(rg.Point3d(0, start_y, 0), rg.Point3d(0, start_y + card_t, 0)).ToNurbsCurve(), 
            True
        )
        cards.append(solid_brep)

    # --- 2. Top Card Profile (Exact Same Height current_h & Notch Shape) ---
    z_top_end = z_top_base + current_h
    t_z_cut_top = z_top_end - cut_margin
    t_z_cut_bottom = t_z_cut_top - cut_h

    pts_top = [
        rg.Point3d(x0, 0, z_top_base),
        rg.Point3d(x1, 0, z_top_base),
        rg.Point3d(x1, 0, t_z_cut_bottom),
        rg.Point3d(x1 - cut_w, 0, t_z_cut_bottom),
        rg.Point3d(x1 - cut_w, 0, t_z_cut_top),
        rg.Point3d(x1, 0, t_z_cut_top),
        rg.Point3d(x1, 0, z_top_end),
        rg.Point3d(x0, 0, z_top_end),
        rg.Point3d(x0, 0, t_z_cut_top),
        rg.Point3d(x0 + cut_w, 0, t_z_cut_top),
        rg.Point3d(x0 + cut_w, 0, t_z_cut_bottom),
        rg.Point3d(x0, 0, t_z_cut_bottom),
        rg.Point3d(x0, 0, z_top_base),
    ]
    top_poly = rg.Polyline(pts_top).ToNurbsCurve()

    top_breps = rg.Brep.CreatePlanarBreps(top_poly, 0.001)
    if top_breps:
        top_face = top_breps[0].Faces[0]
        top_solid = top_face.CreateExtrusion(
            rg.Line(rg.Point3d(0, start_y, 0), rg.Point3d(0, start_y + card_t, 0)).ToNurbsCurve(), 
            True
        )
        top_cards.append(top_solid)

    # --- 3. Country Name Text Outlines on Front Face of Top Card ---
    target_center = rg.Point3d(
        x0 + card_w / 2.0,
        start_y - 0.2,
        z_top_base + current_h * 0.45
    )
    front_text_plane = rg.Plane(target_center, rg.Vector3d(1, 0, 0), rg.Vector3d(0, 0, 1))

    base_text_h = 5.0
    te = rg.TextEntity()
    te.Plane = front_text_plane
    te.PlainText = country
    te.TextHeight = base_text_h
    te.Justification = rg.TextJustification.MiddleCenter

    exploded_crvs = te.Explode()
    if exploded_crvs:
        t_bbox = rg.BoundingBox.Empty
        for crv in exploded_crvs:
            t_bbox.Union(crv.GetBoundingBox(True))
        
        tw = t_bbox.Max.X - t_bbox.Min.X
        max_allowed_w = card_w * 0.72

        if tw > max_allowed_w and max_allowed_w > 0:
            scale_factor = max_allowed_w / tw
            xform_scale = rg.Transform.Scale(target_center, scale_factor)
            for crv in exploded_crvs:
                crv.Transform(xform_scale)

        text_engrave_curves.extend(exploded_crvs)

    # --- 4. Percentage Stripes on Bottom Card ---
    z_bottom = 0.0
    for key, col in TYPES:
        pct = float(row[key])
        seg_h = pct * current_h
        z_top = z_bottom + seg_h

        if seg_h > 0.0001:
            stripe_rect = rg.Rectangle3d(
                rg.Plane(rg.Point3d(0, start_y, 0), rg.Vector3d(1, 0, 0), rg.Vector3d(0, 0, 1)),
                rg.Interval(x0, x1),
                rg.Interval(z_bottom, z_top)
            ).ToNurbsCurve()

            intersections = rg.Curve.CreateBooleanIntersection(stripe_rect, card_poly, 0.001)
            curves_to_surface = intersections if (intersections and len(intersections) > 0) else [stripe_rect]
            for crv in curves_to_surface:
                p_breps = rg.Brep.CreatePlanarBreps(crv, 0.001)
                if p_breps:
                    stripes.append(p_breps[0])
                    colors.append(col)

        z_bottom += seg_h

    # Labels and annotations
    label_pt = rg.Point3d(x0 + card_w / 2.0, start_y - 10, z_top_end + 10)
    labels.append(rg.TextDot("{0} ({1:,.0f})".format(country, total_deaths), label_pt))
    country_names.append("{0}. {1} ({2})".format(idx, country, region))
    country_pts.append(rg.Point3d(x0 + card_w / 2.0, start_y, -5))

    info = "{0} | #{1} | {2} | Deaths: {3:,.0f} | Intrastate {4:.1%} | OneSided {5:.1%} | NonState {6:.1%} | Interstate {7:.1%}".format(
        region, idx, country, total_deaths,
        float(row["Intrastate_pct"]), float(row["OneSided_pct"]),
        float(row["NonState_pct"]), float(row["Interstate_pct"])
    )
    card_info.append(info)

    x_cursor += card_w + gap
# ---------- end ghpython_script ----------
ghpython_script_2 = GhPythonScript(
    csv_path=panel,
    region_filter="Africa",
    card_w=width_2,
    card_h=height_2,
    card_t=number_slider_4,
    gap=gap_2,
    start_x=Slider(1000, range=0..1000),
    start_y=Slider(0, range=0..100),
    min_card_h=minimum_card_height_2,
    max_card_h=maximum_card_height_2)  # -> out, cards, stripes, colors, labels, card_info, country_pts, country_names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; same code as ghpython_script
ghpython_script_3 = GhPythonScript(
    csv_path=panel,
    region_filter="Africa",
    card_w=width_2,
    card_h=height_2,
    card_t=number_slider_4,
    gap=number_slider_2,
    start_x=Slider(-300, range=-300..300),
    start_y=Slider(-124, range=-300..300),
    coffin_margin=number_slider)  # -> out, cards, stripes, colors, labels, card_info, country_pts, country_names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
# ---------- ghpython_script_3: Python ----------
import Rhino.Geometry as rg
import System.Drawing as sd
import csv

# Initialize output lists matching the component outputs
cards = []
stripes = []
colors = []
labels = []
card_info = []
country_pts = []
country_names = []
region_pts = []
region_names = []
coffin_curves = []
coffin_lengths = []
stack_depth_mm = 0.0

# 4 conflict types in stacking order (bottom -> top percentages)
TYPES = [
    ("Intrastate_pct",  sd.Color.FromArgb(68, 114, 196)),   # blue
    ("OneSided_pct",    sd.Color.FromArgb(192, 0, 0)),      # red
    ("NonState_pct",    sd.Color.FromArgb(112, 173, 71)),   # green
    ("Interstate_pct",  sd.Color.FromArgb(112, 48, 160)),   # purple
]

rows = []
with open(csv_path, "r") as f:
    reader = csv.DictReader(f)
    for row in reader:
        if region_filter and row["Region"] != region_filter:
            continue
        rows.append(row)

# Count cards per region to determine coffin lengths
region_card_counts = {}
for row in rows:
    r = row["Region"]
    region_card_counts[r] = region_card_counts.get(r, 0) + 1

region_depths = {}
for r, n in region_card_counts.items():
    region_depths[r] = n * card_t + max(n - 1, 0) * gap


def build_coffin(center_x, y_start, length, base_width):
    shoulder_w = max(length * 0.28, base_width)
    head_w = shoulder_w * (0.20 / 0.28)
    foot_w = shoulder_w * (0.20 / 0.28)
    shoulder_pos = length * 0.30

    head_l = rg.Point3d(center_x - head_w / 2.0, y_start, 0)
    head_r = rg.Point3d(center_x + head_w / 2.0, y_start, 0)
    shoulder_l = rg.Point3d(center_x - shoulder_w / 2.0, y_start + shoulder_pos, 0)
    shoulder_r = rg.Point3d(center_x + shoulder_w / 2.0, y_start + shoulder_pos, 0)
    foot_l = rg.Point3d(center_x - foot_w / 2.0, y_start + length, 0)
    foot_r = rg.Point3d(center_x + foot_w / 2.0, y_start + length, 0)

    pts = [head_l, shoulder_l, foot_l, foot_r, shoulder_r, head_r, head_l]
    poly = rg.Polyline(pts)
    return poly.ToNurbsCurve()


x_box = start_x
y_cursor = start_y
current_region = None
region_gap = card_w * 1.5

for row in rows:
    region = row["Region"]

    if current_region is not None and region != current_region:
        x_box += card_w + region_gap
        y_cursor = start_y

    if region != current_region:
        region_pts.append(rg.Point3d(x_box - card_w * 0.75, start_y, card_h * 0.5))
        region_names.append(region)

        # Offset coffin by 1 card_t at head and foot
        this_length = region_depths[region] + (card_t * 2.0)
        coffin_y_start = start_y - card_t
        this_base_width = card_w + coffin_margin * 2.0

        coffin_curves.append(build_coffin(x_box + card_w / 2.0, coffin_y_start, this_length, this_base_width))
        coffin_lengths.append(this_length)

    current_region = region

    idx = int(row["CardIndex"])
    country = row["Country"]

    # 3D Card box
    x0 = x_box
    x1 = x_box + card_w
    y0 = y_cursor
    y1 = y_cursor + card_t
    box = rg.Box(rg.Plane.WorldXY,
                 rg.Interval(x0, x1),
                 rg.Interval(y0, y1),
                 rg.Interval(0, card_h))
    cards.append(box.ToBrep())

    # Front-face colored stripes
    front_plane = rg.Plane(rg.Point3d(0, y0, 0), rg.Vector3d(1, 0, 0), rg.Vector3d(0, 0, 1))
    z_bottom = 0.0
    for key, col in TYPES:
        pct = float(row[key])
        seg_h = pct * card_h
        if seg_h > 0.0001:
            x_interval = rg.Interval(x0, x1)
            z_interval = rg.Interval(z_bottom, z_bottom + seg_h)
            rect = rg.Rectangle3d(front_plane, x_interval, z_interval)
            planar_breps = rg.Brep.CreatePlanarBreps(rect.ToNurbsCurve(), 0.001)
            if planar_breps:
                stripes.append(planar_breps[0])
                colors.append(col)
        z_bottom += seg_h

    # Labels and annotations
    label_pt = rg.Point3d(x0 + card_w / 2.0, y0 - 10, card_h + 10)
    labels.append(rg.TextDot(country, label_pt))
    country_names.append("{0}. {1} ({2})".format(idx, country, region))
    country_pts.append(rg.Point3d(x0 + card_w / 2.0, y0, -5))

    info = "{0} | #{1} | {2} | Intrastate {3:.1%} | OneSided {4:.1%} | NonState {5:.1%} | Interstate {6:.1%}".format(
        region, idx, country,
        float(row["Intrastate_pct"]), float(row["OneSided_pct"]),
        float(row["NonState_pct"]), float(row["Interstate_pct"]))
    card_info.append(info)

    y_cursor += card_t + gap
    stack_depth_mm = y_cursor - start_y
# ---------- end ghpython_script_3 ----------
ghpython_script_4 = GhPythonScript(
    csv_path=panel,
    region_filter="South America",
    card_w=width_3,
    card_h=height_3,
    card_t=number_slider_5,
    gap=gap_3,
    start_x=Slider(5500, range=0..10000),
    start_y=Slider(0, range=0..100),
    min_card_h=minimum_card_height_3,
    max_card_h=maximum_card_height_3)  # -> out, cards, stripes, colors, labels, card_info, country_pts, country_names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; same code as ghpython_script
ghpython_script_5 = GhPythonScript(
    csv_path=panel,
    region_filter="Asia",
    card_w=width_4,
    card_h=height_4,
    card_t=number_slider_6,
    gap=gap_4,
    start_x=Slider(3000, range=0..10000),
    start_y=Slider(0, range=0..100),
    min_card_h=minimum_card_height_4,
    max_card_h=maximum_card_height_4)  # -> out, cards, stripes, colors, labels, card_info, country_pts, country_names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; same code as ghpython_script
ghpython_script_6 = GhPythonScript(
    csv_path=panel,
    region_filter="South America",
    card_w=width_3,
    card_h=height_3,
    card_t=number_slider_5,
    gap=number_slider_2,
    start_x=Slider(-600, range=-600..600),
    start_y=Slider(-124, range=-300..300),
    coffin_margin=number_slider)  # -> out, cards, stripes, colors, labels, card_info, country_pts, country_names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; same code as ghpython_script_3
ghpython_script_7 = GhPythonScript(
    csv_path=panel,
    region_filter="Asia",
    card_w=width_4,
    card_h=height_4,
    card_t=number_slider_6,
    gap=number_slider_2,
    start_x=Slider(-600, range=-600..600),
    start_y=Slider(-124, range=-300..300),
    coffin_margin=number_slider)  # -> out, cards, stripes, colors, labels, card_info, country_pts, country_names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; same code as ghpython_script_3
ghpython_script_8 = GhPythonScript(
    csv_path=panel,
    region_filter="North America",
    card_w=width_5,
    card_h=height_5,
    card_t=number_slider_7,
    gap=gap_5,
    start_x=Slider(4700, range=0..10000),
    start_y=Slider(0, range=0..100),
    min_card_h=minimum_card_height_5,
    max_card_h=maximum_card_height_5)  # -> out, cards, stripes, colors, labels, card_info, country_pts, country_names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; same code as ghpython_script
ghpython_script_9 = GhPythonScript(
    csv_path=panel,
    region_filter="North America",
    card_w=width_5,
    card_h=height_5,
    card_t=number_slider_7,
    gap=number_slider_2,
    start_x=Slider(-600, range=-600..600),
    start_y=Slider(-124, range=-300..300),
    coffin_margin=number_slider)  # -> out, cards, stripes, colors, labels, card_info, country_pts, country_names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; same code as ghpython_script_3
curve = Curve(ghpython_script.text_engrave_curves)
brep = Brep(ghpython_script.top_cards)
curve_2 = Curve(ghpython_script_2.text_engrave_curves)
brep_2 = Brep(ghpython_script_2.top_cards)
brep_3 = Brep(ghpython_script.cards)
custom_preview = CustomPreview(Geometry=ghpython_script.stripes, Material=ghpython_script.colors)
ghpython_script_10 = GhPythonScript(
    csv_path=panel,
    region_filter=panel_2,
    card_w=width,
    card_h=height,
    card_t=number_slider_3,
    gap=number_slider_2,
    start_x=Slider(-138, range=-500..500),
    start_y=Slider(-122, range=-500..500),
    coffin_margin=number_slider)  # -> out, cards, stripes, colors, labels, card_info, country_pts, country_names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; same code as ghpython_script_3
custom_preview_2 = CustomPreview(Geometry=ghpython_script_2.stripes, Material=ghpython_script_2.colors)
brep_4 = Brep(ghpython_script_2.cards)
panel_3 = Panel(ghpython_script_3.card_info)
brep_5 = Brep(ghpython_script_2.cards)
deconstruct_brep = DeconstructBrep(Brep=brep)  # -> Faces, Edges, Vertices
curve_3 = Curve(ghpython_script_4.text_engrave_curves)
curve_4 = Curve(ghpython_script_5.text_engrave_curves)
brep_6 = Brep(ghpython_script_4.top_cards)
brep_7 = Brep(ghpython_script_5.top_cards)
deconstruct_brep_2 = DeconstructBrep(Brep=brep_2)  # -> Faces, Edges, Vertices
panel_4 = Panel(ghpython_script_3.stack_depth_mm)
custom_preview_3 = CustomPreview(Geometry=ghpython_script_4.stripes, Material=ghpython_script_4.colors)
custom_preview_4 = CustomPreview(Geometry=ghpython_script_5.stripes, Material=ghpython_script_5.colors)
brep_8 = Brep(ghpython_script_4.cards)
panel_5 = Panel(ghpython_script_6.card_info)
brep_9 = Brep(ghpython_script_5.cards)
panel_6 = Panel(ghpython_script_7.card_info)
brep_10 = Brep(ghpython_script_4.cards)
brep_11 = Brep(ghpython_script_5.cards)
curve_5 = Curve(ghpython_script_8.text_engrave_curves)
brep_12 = Brep(ghpython_script_8.top_cards)
list_item = ListItem(List=brep_4, Index=0, Wrap=True)
panel_7 = Panel(ghpython_script_3.coffin_lengths)
deconstruct_brep_3 = DeconstructBrep(Brep=brep_6)  # -> Faces, Edges, Vertices
custom_preview_5 = CustomPreview(Geometry=ghpython_script_8.stripes, Material=ghpython_script_8.colors)
list_length = ListLength(List=ghpython_script.cards)
deconstruct_brep_4 = DeconstructBrep(Brep=brep_7)  # -> Faces, Edges, Vertices
brep_13 = Brep(ghpython_script_8.cards)
panel_8 = Panel(ghpython_script_9.card_info)
brep_14 = Brep(ghpython_script_8.cards)
panel_9 = Panel(ghpython_script_6.stack_depth_mm)
panel_10 = Panel(ghpython_script_7.stack_depth_mm)
deconstruct_brep_5 = DeconstructBrep(Brep=brep_12)  # -> Faces, Edges, Vertices
list_item_2 = ListItem(List=brep_3, Index=Slider(0, range=0..100), Wrap=True)
list_item_3 = ListItem(List=brep_8, Index=0, Wrap=True)
list_item_4 = ListItem(List=deconstruct_brep.Faces, Index=0, Wrap=True)
list_item_5 = ListItem(List=brep_9, Index=0, Wrap=True)
panel_11 = Panel(ghpython_script_6.coffin_lengths)
panel_12 = Panel(ghpython_script_7.coffin_lengths)
panel_13 = Panel(ghpython_script_9.stack_depth_mm)
number_slider_8 = Slider(2, range=-10..10)  # disabled
list_item_6 = ListItem(List=brep_5, Index=Slider(0, range=0..100), Wrap=True)
list_length_2 = ListLength(List=ghpython_script_2.cards)
list_item_7 = ListItem(List=deconstruct_brep_2.Faces, Index=0, Wrap=True)
list_item_8 = ListItem(List=brep_13, Index=0, Wrap=True)
panel_14 = Panel(ghpython_script_9.coffin_lengths)
list_item_9 = ListItem(List=brep_10, Index=Slider(0, range=0..100), Wrap=True)
list_length_3 = ListLength(List=ghpython_script_4.cards)
list_item_10 = ListItem(List=brep_11, Index=Slider(0, range=0..100), Wrap=True)
list_length_4 = ListLength(List=ghpython_script_5.cards)
list_item_11 = ListItem(List=deconstruct_brep_3.Faces, Index=0, Wrap=True)
list_item_12 = ListItem(List=deconstruct_brep_4.Faces, Index=0, Wrap=True)
panel_15 = Panel(list_item_2)
panel_16 = Panel(list_length)
panel_17 = Panel(ghpython_script_2.card_info)
panel_18 = Panel(list_item_6)
panel_19 = Panel(list_length_2)
list_item_13 = ListItem(List=brep_14, Index=Slider(0, range=0..100), Wrap=True)
list_length_5 = ListLength(List=ghpython_script_8.cards)
list_item_14 = ListItem(List=deconstruct_brep_5.Faces, Index=0, Wrap=True)
pull_curve = PullCurve(Curve=curve, Surface=list_item_4)
brep_edges = BrepEdges(Brep=list_item_4)  # -> Naked, Interior, NonManifold
pull_curve_2 = PullCurve(Curve=curve_2, Surface=list_item_7)
brep_edges_2 = BrepEdges(Brep=list_item_7)  # -> Naked, Interior, NonManifold
panel_20 = Panel(ghpython_script_4.card_info)
panel_21 = Panel(ghpython_script_5.card_info)
panel_22 = Panel(list_item_9)
panel_23 = Panel(list_length_3)
panel_24 = Panel(list_item_10)
panel_25 = Panel(list_length_4)
curve_6 = Curve(ghpython_script_3.coffin_curves)
panel_26 = Panel(ghpython_script_8.card_info)
pull_curve_3 = PullCurve(Curve=curve_3, Surface=list_item_11)
brep_edges_3 = BrepEdges(Brep=list_item_11)  # -> Naked, Interior, NonManifold
pull_curve_4 = PullCurve(Curve=curve_4, Surface=list_item_12)
brep_edges_4 = BrepEdges(Brep=list_item_12)  # -> Naked, Interior, NonManifold
panel_27 = Panel(list_item_13)
panel_28 = Panel(list_length_5)
negative = Negative(Value=number_slider_3)
number_slider_9 = Slider(90, range=0..100)  # disabled
division = Division(A=width, B=number_slider_8)  # disabled
number_slider_10 = Slider(1, range=0..1)  # disabled
negative_2 = Negative(Value=number_slider_4)
pull_curve_5 = PullCurve(Curve=curve_5, Surface=list_item_14)
brep_edges_5 = BrepEdges(Brep=list_item_14)  # -> Naked, Interior, NonManifold
list_item_15 = ListItem(List=ghpython_script_10.cards, Index=0, Wrap=True)  # disabled
curve_7 = Curve(ghpython_script_6.coffin_curves)
curve_8 = Curve(ghpython_script_7.coffin_curves)
panel_29 = Panel(ghpython_script.card_info)
panel_30 = Panel(ghpython_script_10.stack_depth_mm)  # disabled
join_curves = JoinCurves(Curves=[pull_curve, brep_edges.Naked], Preserve=False)
panel_31 = Panel(ghpython_script_10.coffin_lengths)  # disabled
brep_15 = Brep(ghpython_script_10.cards)  # disabled
join_curves_2 = JoinCurves(Curves=[pull_curve_2, brep_edges_2.Naked], Preserve=False)
curve_9 = Curve(ghpython_script_9.coffin_curves)
negative_3 = Negative(Value=number_slider_5)
negative_4 = Negative(Value=number_slider_6)
panel_32 = Panel(ghpython_script_10.card_info)  # disabled
curve_10 = Curve(ghpython_script_10.coffin_curves)
negative_5 = Negative(Value=number_slider_7)
deconstruct_brep_6 = DeconstructBrep(Brep=ghpython_script_3.cards)  # -> Faces, Edges, Vertices
join_curves_3 = JoinCurves(Curves=[pull_curve_3, brep_edges_3.Naked], Preserve=False)
# Base surface top part
boundary_surfaces = BoundarySurfaces(Edges=curve_6)
join_curves_4 = JoinCurves(Curves=[pull_curve_4, brep_edges_4.Naked], Preserve=False)
number_slider_11 = Slider(0, range=0..100)  # disabled
deconstruct_brep_7 = DeconstructBrep(Brep=ghpython_script_10.cards)  # -> Faces, Edges, Vertices

# ----
# Base surface top part
boundary_surfaces_2 = BoundarySurfaces(Edges=curve_10)

negative_6 = Negative(Value=number_slider_9)  # disabled
join_curves_5 = JoinCurves(Curves=[pull_curve_5, brep_edges_5.Naked], Preserve=False)

# ----
# Country
number_slider_12 = Slider(-20, range=-30..30)
unit_z = UnitZ(Factor=number_slider_12)
point = Point(ghpython_script.country_pts)
move = Move(Geometry=point, Motion=unit_z)  # -> Geometry, Transform
xz_plane = XZPlane(Origin=move.Geometry)
panel_33 = Panel(point)
rotate = Rotate(Geometry=xz_plane, Angle=degrees(Slider(90, range=0..100)), Plane=xz_plane)  # -> Geometry, Transform
text_tag_3d = TextTag3D(
    Location=rotate.Geometry,
    Text=ghpython_script.country_names,
    Size=Slider(2, range=0..10),
    Colour=ColourSwatch(SwatchColor=RGB(0, 0, 0)),
    Justification=7)

deconstruct_brep_8 = DeconstructBrep(Brep=ghpython_script_6.cards)  # -> Faces, Edges, Vertices
deconstruct_brep_9 = DeconstructBrep(Brep=ghpython_script_7.cards)  # -> Faces, Edges, Vertices
boundary_surfaces_3 = BoundarySurfaces(Edges=curve_7)
# Base surface top part
boundary_surfaces_4 = BoundarySurfaces(Edges=curve_8)
unit_z_2 = UnitZ(Factor=negative_2)
addition = Addition(A=division, B=number_slider_10)  # disabled
deconstruct_brep_10 = DeconstructBrep(Brep=ghpython_script_9.cards)  # -> Faces, Edges, Vertices
boundary_surfaces_5 = BoundarySurfaces(Edges=curve_9)

# ----
# Continant
xz_plane_2 = XZPlane(Origin=ghpython_script.region_pts)
text_tag_3d_2 = TextTag3D(
    Location=xz_plane_2,
    Text=ghpython_script.region_names,
    Size=Slider(5, range=0..10),
    Colour=ColourSwatch(SwatchColor=RGB(0, 0, 0)),
    Justification=7)

unit_z_3 = UnitZ(Factor=negative)
# Country
# Continant
xz_plane_3 = XZPlane(Origin=ghpython_script_2.region_pts)
list_item_16 = ListItem(List=deconstruct_brep_6.Faces, Index=Slider(4, range=0..10), Wrap=True)  # -> flatten(Item)
rotate_axis = RotateAxis(
    Geometry=brep_15,
    Angle=degrees(negative_6),
    Axis=reverse(Line((-117.6654083, 0, -1.071794172), (-117.6654083, 0, 127.7421574))))  # -> Geometry, Transform; disabled
# Continant
unit_z_4 = UnitZ(Factor=negative_3)
unit_z_5 = UnitZ(Factor=negative_4)
list_item_17 = ListItem(List=deconstruct_brep_7.Faces, Index=Slider(4, range=0..10), Wrap=True)  # -> flatten(Item)
# Continant
unit_z_6 = UnitZ(Factor=negative_5)
xz_plane_4 = XZPlane(Origin=ghpython_script_4.region_pts)
list_item_18 = ListItem(List=deconstruct_brep_8.Faces, Index=Slider(4, range=0..10), Wrap=True)  # -> flatten(Item)
# Country
xz_plane_5 = XZPlane(Origin=ghpython_script_5.region_pts)
list_item_19 = ListItem(List=deconstruct_brep_9.Faces, Index=Slider(4, range=0..10), Wrap=True)  # -> flatten(Item)
negative_7 = Negative(Value=addition)  # disabled
brep_edges_6 = BrepEdges(Brep=list_item_16)  # -> flatten(Naked), Interior, NonManifold
xz_plane_6 = XZPlane(Origin=ghpython_script_8.region_pts)
# Base extrusion
extrude = Extrude(Base=boundary_surfaces, Direction=unit_z_2)
list_item_20 = ListItem(List=deconstruct_brep_10.Faces, Index=Slider(4, range=0..10), Wrap=True)  # -> flatten(Item)
unit_z_7 = UnitZ(Factor=Slider(-20, range=-30..30))
point_2 = Point(ghpython_script_2.country_pts)
brep_edges_7 = BrepEdges(Brep=list_item_17)  # -> flatten(Naked), Interior, NonManifold

# ----
# Base extrusion
extrude_2 = Extrude(Base=boundary_surfaces_2, Direction=unit_z_3)

list_item_21 = ListItem(List=rotate_axis.Geometry, Index=expr("-1", 0), Wrap=True)  # disabled
brep_edges_8 = BrepEdges(Brep=list_item_18)  # -> flatten(Naked), Interior, NonManifold
brep_edges_9 = BrepEdges(Brep=list_item_19)  # -> flatten(Naked), Interior, NonManifold
extrude_3 = Extrude(Base=boundary_surfaces_3, Direction=unit_z_4)
list_item_22 = ListItem(List=rotate_axis.Geometry, Index=number_slider_11, Wrap=True)  # disabled
# Base extrusion
extrude_4 = Extrude(Base=boundary_surfaces_4, Direction=unit_z_5)
unit_z_8 = UnitZ(Factor=Slider(-20, range=-30..30))
unit_z_9 = UnitZ(Factor=Slider(-20, range=-30..30))
number_slider_13 = Slider(2.5, range=0..10)  # disabled
unit_y = UnitY(Factor=negative_7)  # disabled
point_3 = Point(ghpython_script_4.country_pts)
point_4 = Point(ghpython_script_5.country_pts)
brep_edges_10 = BrepEdges(Brep=list_item_20)  # -> flatten(Naked), Interior, NonManifold
extrude_5 = Extrude(Base=boundary_surfaces_5, Direction=unit_z_6)
unit_z_10 = UnitZ(Factor=Slider(-20, range=-30..30))
number_slider_14 = Slider(2, range=0..10)  # disabled
point_5 = Point(ghpython_script_8.country_pts)
move_2 = Move(Geometry=point_2, Motion=unit_z_7)  # -> Geometry, Transform
deconstruct_brep_11 = DeconstructBrep(Brep=extrude)  # -> Faces, Edges, Vertices
pull_curve_6 = PullCurve(Curve=brep_edges_6.Naked, Surface=boundary_surfaces)
text_tag_3d_3 = TextTag3D(
    Location=xz_plane_3,
    Text=ghpython_script_2.region_names,
    Size=Slider(5, range=0..10),
    Colour=ColourSwatch(SwatchColor=RGB(0, 0, 0)),
    Justification=7)
area = Area(Geometry=list_item_22)  # -> Area, Centroid; disabled
deconstruct_brep_12 = DeconstructBrep(Brep=list_item_22)  # -> Faces, Edges, Vertices; disabled
deconstruct_brep_13 = DeconstructBrep(Brep=extrude_2)  # -> Faces, Edges, Vertices
deconstruct_brep_14 = DeconstructBrep(Brep=list_item_21)  # -> Faces, Edges, Vertices; disabled
move_3 = Move(Geometry=point_3, Motion=unit_z_8)  # -> Geometry, Transform
move_4 = Move(Geometry=point_4, Motion=unit_z_9)  # -> Geometry, Transform
pull_curve_7 = PullCurve(Curve=brep_edges_7.Naked, Surface=boundary_surfaces_2)
deconstruct_brep_15 = DeconstructBrep(Brep=extrude_3)  # -> Faces, Edges, Vertices
deconstruct_brep_16 = DeconstructBrep(Brep=extrude_4)  # -> Faces, Edges, Vertices
pull_curve_8 = PullCurve(Curve=brep_edges_8.Naked, Surface=boundary_surfaces_3)
pull_curve_9 = PullCurve(Curve=brep_edges_9.Naked, Surface=boundary_surfaces_4)
text_tag_3d_4 = TextTag3D(
    Location=xz_plane_4,
    Text=ghpython_script_4.region_names,
    Size=Slider(5, range=0..10),
    Colour=ColourSwatch(SwatchColor=RGB(0, 0, 0)),
    Justification=7)
text_tag_3d_5 = TextTag3D(
    Location=xz_plane_5,
    Text=ghpython_script_5.region_names,
    Size=Slider(5, range=0..10),
    Colour=ColourSwatch(SwatchColor=RGB(0, 0, 0)),
    Justification=7)
move_5 = Move(Geometry=point_5, Motion=unit_z_10)  # -> Geometry, Transform
deconstruct_brep_17 = DeconstructBrep(Brep=extrude_5)  # -> Faces, Edges, Vertices
xz_plane_7 = XZPlane(Origin=move_2.Geometry)

# ----
# Base surface
list_item_23 = ListItem(List=deconstruct_brep_11.Faces, Index=-1, Wrap=True)

pull_curve_10 = PullCurve(Curve=brep_edges_10.Naked, Surface=boundary_surfaces_5)
panel_34 = Panel(point_2)
text_tag_3d_6 = TextTag3D(
    Location=xz_plane_6,
    Text=ghpython_script_8.region_names,
    Size=Slider(5, range=0..10),
    Colour=ColourSwatch(SwatchColor=RGB(0, 0, 0)),
    Justification=7)
list_item_24 = ListItem(List=deconstruct_brep_12.Vertices, Index=0, Wrap=True)  # -> Item, Item1; disabled
addition_2 = Addition(A=number_slider_3, B=number_slider_13)  # disabled

# ----
# Base surface
list_item_25 = ListItem(List=deconstruct_brep_13.Faces, Index=-1, Wrap=True)

list_item_26 = ListItem(List=deconstruct_brep_14.Vertices, Index=number_slider_14, Wrap=True)  # disabled
surface_split = SurfaceSplit(Surface=boundary_surfaces, Curves=pull_curve_6)
xz_plane_8 = XZPlane(Origin=move_3.Geometry)
xz_plane_9 = XZPlane(Origin=move_4.Geometry)
list_item_27 = ListItem(List=deconstruct_brep_15.Faces, Index=-1, Wrap=True)
# Base surface
list_item_28 = ListItem(List=deconstruct_brep_16.Faces, Index=-1, Wrap=True)
panel_35 = Panel(point_3)
panel_36 = Panel(point_4)
surface_split_2 = SurfaceSplit(Surface=boundary_surfaces_2, Curves=pull_curve_7)
xz_plane_10 = XZPlane(Origin=move_5.Geometry)
move_6 = Move(Geometry=area.Centroid, Motion=unit_y)  # -> Geometry, Transform; disabled
brep_edges_11 = BrepEdges(Brep=list_item_23)  # -> Naked, Interior, NonManifold
list_item_29 = ListItem(List=deconstruct_brep_17.Faces, Index=-1, Wrap=True)
surface_split_3 = SurfaceSplit(Surface=boundary_surfaces_3, Curves=pull_curve_8)
surface_split_4 = SurfaceSplit(Surface=boundary_surfaces_4, Curves=pull_curve_9)
panel_37 = Panel(point_5)
brep_edges_12 = BrepEdges(Brep=list_item_25)  # -> Naked, Interior, NonManifold
rotate_2 = Rotate(Geometry=xz_plane_7, Angle=degrees(Slider(90, range=0..100)), Plane=xz_plane_7)  # -> Geometry, Transform
surface_split_5 = SurfaceSplit(Surface=boundary_surfaces_5, Curves=pull_curve_10)
brep_edges_13 = BrepEdges(Brep=list_item_27)  # -> Naked, Interior, NonManifold
brep_edges_14 = BrepEdges(Brep=list_item_28)  # -> Naked, Interior, NonManifold

# ----
# Holding base
list_item_30 = ListItem(List=surface_split, Index=0, Wrap=True)

unit_x = UnitX(Factor=addition_2)  # disabled
unit_y_2 = UnitY(Factor=addition_2)  # disabled
unit_y_3 = UnitY(Factor=number_slider_3)  # disabled
brep_edges_15 = BrepEdges(Brep=list_item_29)  # -> Naked, Interior, NonManifold
rotate_3 = Rotate(Geometry=xz_plane_8, Angle=degrees(Slider(90, range=0..100)), Plane=xz_plane_8)  # -> Geometry, Transform

# ----
# Holding base
list_item_31 = ListItem(List=surface_split_2, Index=0, Wrap=True)

rotate_4 = Rotate(Geometry=xz_plane_9, Angle=degrees(Slider(90, range=0..100)), Plane=xz_plane_9)  # -> Geometry, Transform
point_6 = Point(list_item_24.Item)  # disabled
point_7 = Point(list_item_24.Item1)  # disabled
join_curves_6 = JoinCurves(Curves=brep_edges_11.Naked, Preserve=False)
list_item_32 = ListItem(List=surface_split_3, Index=0, Wrap=True)
# Holding base
list_item_33 = ListItem(List=surface_split_4, Index=0, Wrap=True)
xz_plane_11 = XZPlane(Origin=move_6.Geometry)  # disabled
rotate_5 = Rotate(Geometry=xz_plane_10, Angle=degrees(Slider(90, range=0..100)), Plane=xz_plane_10)  # -> Geometry, Transform
join_curves_7 = JoinCurves(Curves=brep_edges_12.Naked, Preserve=False)
list_item_34 = ListItem(List=surface_split_5, Index=0, Wrap=True)
join_curves_8 = JoinCurves(Curves=brep_edges_13.Naked, Preserve=False)
join_curves_9 = JoinCurves(Curves=brep_edges_14.Naked, Preserve=False)
join_curves_10 = JoinCurves(Curves=brep_edges_15.Naked, Preserve=False)
text_tag_3d_7 = TextTag3D(
    Location=rotate_2.Geometry,
    Text=ghpython_script_2.country_names,
    Size=Slider(2, range=0..10),
    Colour=ColourSwatch(SwatchColor=RGB(0, 0, 0)),
    Justification=7)
rotate_6 = Rotate(Geometry=xz_plane_11, Angle=degrees(1.570796327), Plane=xz_plane_11)  # -> Geometry, Transform; disabled
offset_curve = OffsetCurve(Curve=join_curves_6, Distance=number_slider_4, Corners=1)
negative_8 = Negative(Value=unit_x)  # disabled
negative_9 = Negative(Value=unit_y_2)  # disabled
offset_curve_2 = OffsetCurve(Curve=join_curves_7, Distance=number_slider_3, Corners=1)
text_tag_3d_8 = TextTag3D(
    Location=rotate_3.Geometry,
    Text=ghpython_script_4.country_names,
    Size=Slider(2, range=0..10),
    Colour=ColourSwatch(SwatchColor=RGB(0, 0, 0)),
    Justification=7)
text_tag_3d_9 = TextTag3D(
    Location=rotate_4.Geometry,
    Text=ghpython_script_5.country_names,
    Size=Slider(2, range=0..10),
    Colour=ColourSwatch(SwatchColor=RGB(0, 0, 0)),
    Justification=7)
offset_curve_3 = OffsetCurve(Curve=join_curves_8, Distance=number_slider_5, Corners=1)
offset_curve_4 = OffsetCurve(Curve=join_curves_9, Distance=number_slider_6, Corners=1)
text_tag_3d_10 = TextTag3D(
    Location=rotate_5.Geometry,
    Text=ghpython_script_8.country_names,
    Size=Slider(2, range=0..10),
    Colour=ColourSwatch(SwatchColor=RGB(0, 0, 0)),
    Justification=7)
offset_curve_5 = OffsetCurve(Curve=join_curves_10, Distance=number_slider_7, Corners=1)
loft = Loft(
    Curves=flatten([offset_curve, join_curves_6]),
    Options={Adjust=False, Closed=False, LoftEnds=0, LoftSimp=0, LoftType=0, Rebuild=10, Refit=0.01})
unit_z_11 = UnitZ(Factor=Slider(50, range=0..100))
loft_2 = Loft(
    Curves=flatten([offset_curve_2, join_curves_7]),
    Options={Adjust=False, Closed=False, LoftEnds=0, LoftSimp=0, LoftType=0, Rebuild=10, Refit=0.01})
unit_z_12 = UnitZ(Factor=number_slider_4)
loft_3 = Loft(
    Curves=flatten([offset_curve_3, join_curves_8]),
    Options={Adjust=False, Closed=False, LoftEnds=0, LoftSimp=0, LoftType=0, Rebuild=10, Refit=0.01})
loft_4 = Loft(
    Curves=flatten([offset_curve_4, join_curves_9]),
    Options={Adjust=False, Closed=False, LoftEnds=0, LoftSimp=0, LoftType=0, Rebuild=10, Refit=0.01})
unit_z_13 = UnitZ(Factor=Slider(50, range=0..100))
unit_z_14 = UnitZ(Factor=Slider(50, range=0..100))
unit_z_15 = UnitZ(Factor=Slider(50, range=0..100))
number_slider_15 = Slider(6, range=0..10)  # disabled
unit_z_16 = UnitZ(Factor=number_slider_5)
unit_z_17 = UnitZ(Factor=number_slider_6)
loft_5 = Loft(
    Curves=flatten([offset_curve_5, join_curves_10]),
    Options={Adjust=False, Closed=False, LoftEnds=0, LoftSimp=0, LoftType=0, Rebuild=10, Refit=0.01})
unit_z_18 = UnitZ(Factor=number_slider_3)
unit_z_19 = UnitZ(Factor=Slider(50, range=0..100))
unit_z_20 = UnitZ(Factor=number_slider_7)
colour_swatch = ColourSwatch(SwatchColor=RGB(255, 255, 255))  # disabled
# Coffin box
extrude_6 = Extrude(Base=loft, Direction=unit_z_11)
extrude_7 = Extrude(Base=list_item_30, Direction=unit_z_12)

# ----
# Coffin box
extrude_8 = Extrude(Base=loft_2, Direction=unit_z_13)

extrude_9 = Extrude(Base=list_item_31, Direction=unit_z_18)
extrude_10 = Extrude(Base=loft_3, Direction=unit_z_14)
# Coffin box
extrude_11 = Extrude(Base=loft_4, Direction=unit_z_15)
extrude_12 = Extrude(Base=list_item_32, Direction=unit_z_16)
extrude_13 = Extrude(Base=list_item_33, Direction=unit_z_17)
extrude_14 = Extrude(Base=loft_5, Direction=unit_z_19)
text_tag_3d_11 = TextTag3D(
    Location=rotate_6.Geometry,
    Text=ghpython_script_10.region_names,
    Size=number_slider_15,
    Colour=colour_swatch,
    Justification=7)  # disabled
extrude_15 = Extrude(Base=list_item_34, Direction=unit_z_20)
move_7 = Move(Geometry=point_6, Motion=negative_8)  # -> Geometry, Transform; disabled
move_8 = Move(Geometry=point_7, Motion=negative_8)  # -> Geometry, Transform; disabled
move_9 = Move(Geometry=list_item_26, Motion=unit_x)  # -> Geometry, Transform; disabled
move_10 = Move(Geometry=move_8.Geometry, Motion=negative_9)  # -> Geometry, Transform; disabled
move_11 = Move(Geometry=move_7.Geometry, Motion=unit_y_2)  # -> Geometry, Transform; disabled
move_12 = Move(Geometry=move_10.Geometry, Motion=unit_y_3)  # -> Geometry, Transform; disabled
move_13 = Move(Geometry=move_9.Geometry, Motion=negative_9)  # -> Geometry, Transform; disabled
negative_10 = Negative(Value=number_slider_3)  # disabled
box_2pt = Box2Pt(PointA=move_12.Geometry, PointB=move_13.Geometry, Plane=PlaneXY(0, 0, 0))  # disabled
box_2pt_2 = Box2Pt(PointA=move_11.Geometry, PointB=move_13.Geometry, Plane=PlaneXY(0, 0, 0))  # disabled
deconstruct_brep_18 = DeconstructBrep(Brep=box_2pt_2)  # -> Faces, Edges, Vertices; disabled
deconstruct_brep_19 = DeconstructBrep(Brep=box_2pt)  # -> Faces, Edges, Vertices; disabled
number_slider_16 = Slider(20, range=0..100)  # disabled
list_item_35 = ListItem(List=deconstruct_brep_18.Vertices, Index=0, Wrap=True)  # -> Item, Item1, Item2; disabled
number_slider_17 = Slider(0.7, range=0..1)  # disabled
number_slider_18 = Slider(0.3, range=0..1)  # disabled
list_item_36 = ListItem(List=deconstruct_brep_18.Edges, Index=0, Wrap=True)  # -> Item, Item1, Item2; disabled
point_8 = Point(list_item_35.Item2)  # disabled
curve_11 = Curve(list_item_36.Item)  # disabled
curve_12 = Curve(list_item_36.Item2)  # disabled

# ----
# Base
offset_surface = OffsetSurface(Surface=deconstruct_brep_18.Faces, Distance=negative_10, BothSides=0, CreateSolid=True)  # disabled

# ----
# side 3
offset_surface_2 = OffsetSurface(Surface=deconstruct_brep_19.Faces, Distance=number_slider_16, BothSides=0, CreateSolid=True)  # disabled

number_slider_19 = Slider(0, range=0..100)  # disabled
number_slider_20 = Slider(3, range=0..10)  # disabled
number_slider_21 = Slider(10, range=0..10)  # disabled
evaluate_length = EvaluateLength(Curve=curve_12, Length=number_slider_17, Normalized=True)  # -> Point, Tangent, Parameter; disabled
evaluate_length_2 = EvaluateLength(Curve=curve_11, Length=number_slider_18, Normalized=True)  # -> Point, Tangent, Parameter; disabled
number_slider_22 = Slider(7, range=0..10)  # disabled
deconstruct_brep_20 = DeconstructBrep(Brep=offset_surface)  # -> Faces, Edges, Vertices; disabled
number_slider_23 = Slider(0.28, range=0..1)  # disabled
deconstruct_brep_21 = DeconstructBrep(Brep=offset_surface_2)  # -> Faces, Edges, Vertices; disabled
distance = Distance(PointA=move_11.Geometry, PointB=point_8)  # disabled
list_item_37 = ListItem(List=deconstruct_brep_20.Vertices, Index=number_slider_20, Wrap=True)  # disabled
list_item_38 = ListItem(List=deconstruct_brep_20.Vertices, Index=number_slider_19, Wrap=True)  # disabled
negative_11 = Negative(Value=number_slider_21)  # disabled
list_item_39 = ListItem(List=deconstruct_brep_21.Vertices, Index=number_slider_22, Wrap=True)  # disabled
line = Line(StartPoint=evaluate_length_2.Point, EndPoint=evaluate_length.Point)  # disabled
unit_y_4 = UnitY(Factor=negative_11)  # disabled
distance_2 = Distance(PointA=list_item_37, PointB=list_item_38)  # disabled
multiplication = Multiplication(A=distance, B=number_slider_23)  # disabled
unit_y_5 = UnitY(Factor=number_slider_21)  # disabled
move_14 = Move(Geometry=evaluate_length_2.Point, Motion=unit_y_4)  # -> Geometry, Transform; disabled
move_15 = Move(Geometry=evaluate_length.Point, Motion=unit_y_5)  # -> Geometry, Transform; disabled
subtraction = Subtraction(A=distance_2, B=number_slider_3)  # disabled
unit_y_6 = UnitY(Factor=subtraction)  # disabled

# ----
# side 2
move_16 = Move(Geometry=offset_surface_2, Motion=unit_y_6)  # -> Geometry, Transform; disabled

number_slider_24 = Slider(0, range=0..10)  # disabled
deconstruct_brep_22 = DeconstructBrep(Brep=move_16.Geometry)  # -> Faces, Edges, Vertices; disabled
list_item_40 = ListItem(List=deconstruct_brep_22.Vertices, Index=number_slider_24, Wrap=True)  # disabled
box_2pt_3 = Box2Pt(PointA=list_item_40, PointB=list_item_39, Plane=PlaneXY(0, 0, 0))  # disabled

# ----
# side 1
offset_surface_3 = OffsetSurface(Surface=box_2pt_3, Distance=number_slider_3, BothSides=0, CreateSolid=True)  # disabled
